# Grasshopper definition counter_dail_subtractions.gh (Grasshopper 1.0.8)

number_slider = Slider(0.29, range=0..1)
crv = Curve([<curve referenced from the Rhino model> x20])
multiplication = Multiplication(A=number_slider, B="-1")
offset = OffsetCurve(Curve=crv, Distance=multiplication, Corners=1)
offset_2 = OffsetCurve(Curve=crv, Distance=number_slider, Corners=1)
end = EndPoints(Curve=offset_2)  # -> Start, End
end_2 = EndPoints(Curve=offset)  # -> Start, End
ln = Line(StartPoint=end.Start, EndPoint=end_2.Start)
ln_2 = Line(StartPoint=end.End, EndPoint=end_2.End)
merge = Merge(Data1=offset_2, Data2=ln, Data3=ln_2, Data4=offset)
join = JoinCurves(Curves=merge, Preserve=False)  # -> simplify(Curves)
Z = UnitZ(Factor=1)
multiplication_2 = Multiplication(A=Z, B="-1")
panel = Panel(join)
patch = Patch(Curves=join, Spans=20, Flexibility=1, Trim=True)
extr = Extrude(Base=patch, Direction=multiplication_2)  # -> flatten(Extrusion)
brep = Brep(<brep referenced from the Rhino model>)
sdiff = SolidDifference(BrepsA=brep, BrepsB=extr)
